# Grasshopper definition kvp_control_v2.gh (Grasshopper 1.0.7)
# plug-ins: Robots

a1 = Slider(0, range=-185..185)
a2 = Slider(-90, range=-135..35)
a3 = Slider(120, range=-120..158)
a4 = Slider(0, range=-350..350)
a6 = Slider(0, range=-350..350)
e1 = Slider(2500, range=1000..4000)
a1_2 = Slider(0, range=-185..185)
a5 = Slider(0, range=-119..119)
send = Button()
sendposition = GhPythonScript(A1=a1, A2=a2, A3=a3, A4=a4, A5=a5, A6=a6, E1=e1, Send=send)  # -> a
# ---------- sendposition: Python ----------
from ghpythonlib.componentbase import executingcomponent as component
import Grasshopper, GhPython
import System
import Rhino
import rhinoscriptsyntax as rs
import sys
import struct
import random
import socket

PY2 = sys.version_info[0] == 2

class MyComponent(component):
    
    def RunScript(self, ip, port, A1, A2, A3, A4, A5, A6, E1, send):
        if send:
            ip = ip or "172.31.1.147"
            port = port or 7000
            client = openshowvar(ip, port)
            
            address = "AXIS_SET"
            value = "{{E6AXIS: A1 {}, A2 {}, A3 {}, A4 {}, A5 {}, A6 {}, E1 {}}}".format(A1, A2, A3, A4, A5, A6, E1)
            
            print(value)
            resp = client.write(address, value, False)
            client.close()
            return resp
        # return outputs if you have them; here I try it for you:
        return ""


class openshowvar(object):
    def __init__(self, ip, port):
        self.ip = ip
        self.port = port
        self.msg_id = random.randint(1, 100)
        self.sock = socket.socket(socket.AF_INET, socket.SOCK_STREAM)
        try:
            self.sock.connect((self.ip, self.port))
        except socket.error:
            pass

    def test_connection(self):
        sock = socket.socket(socket.AF_INET, socket.SOCK_STREAM)
        try:
            ret = sock.connect_ex((self.ip, self.port))
            return ret == 0
        except socket.error:
            print('socket error')
            return False

    can_connect = property(test_connection)

    def read(self, var, debug=True):
        if not isinstance(var, str):
            raise Exception('Var name is a string')
        else:
            self.varname = var if PY2 else var.encode(ENCODING)
        return self._read_var(debug)

    def write(self, var, value, debug=True):
        if not (isinstance(var, str) and isinstance(value, str)):
            raise Exception('Var name and its value should be string')
        self.varname = var if PY2 else var.encode(ENCODING)
        self.value = value if PY2 else value.encode(ENCODING)
        return self._write_var(debug)

    def _read_var(self, debug):
        req = self._pack_read_req()
        self._send_req(req)
        _value = self._read_rsp(debug)
        if debug:
            print(_value)
        return _value

    def _write_var(self, debug):
        req = self._pack_write_req()
        self._send_req(req)
        _value = self._read_rsp(debug)
        if debug:
            print(_value)
        return _value

    def _send_req(self, req):
        self.rsp = None
        self.sock.sendall(req)
        self.rsp = self.sock.recv(256)

    def _pack_read_req(self):
        var_name_len = len(self.varname)
        flag = 0
        req_len = var_name_len + 3

        return struct.pack(
            '!HHBH'+str(var_name_len)+'s',
            self.msg_id,
            req_len,
            flag,
            var_name_len,
            self.varname
            )

    def _pack_write_req(self):
        var_name_len = len(self.varname)
        flag = 1
        value_len = len(self.value)
        req_len = var_name_len + 3 + 2 + value_len

        return struct.pack(
            '!HHBH'+str(var_name_len)+'s'+'H'+str(value_len)+'s',
            self.msg_id,
            req_len,
            flag,
            var_name_len,
            self.varname,
            value_len,
            self.value
            )

    def _read_rsp(self, debug=False):
        if self.rsp is None: return None
        var_value_len = len(self.rsp) - struct.calcsize('!HHBH') - 3
        result = struct.unpack('!HHBH'+str(var_value_len)+'s'+'3s', self.rsp)
        _msg_id, body_len, flag, var_value_len, var_value, isok = result
        if debug:
            print('[DEBUG]', result)
        if result[-1].endswith(b'\x01') and _msg_id == self.msg_id:
            self.msg_id = (self.msg_id + 1) % 65536  # format char 'H' is 2 bytes long
            return var_value

    def close(self):
        self.sock.close()
# ---------- end sendposition ----------
panel = Panel(sendposition)
list = RobotsLibrary(
    {"Franka Emika Panda", "Bartlett-IRB120", "Bartlett-IRB1600", "Bartlett-KR6", "Bartlett-KR60-A", "Bartlett-KR60-B", "Bartlett-KR500", "Bartlett-KR60 on track", "Bartlett-UR10", "Bartlett-KR60", "Bartlett-TX200", "Bartlett-TX200L", "Bartlett-RX160", "Bartlett-RX160L"}, selected="Bartlett-KR60 on track",
    Type=0)
loadrobot = LoadRobotSystem(Name=list, Base=PlaneXY(0, 0, 0))
a1_3 = Slider(0, range=-185..185)
a6_2 = Slider(0, range=-350..350)
e1_2 = Slider(3200, range=1000..4000)
a2_2 = Slider(-90, range=-135..35)
a4_2 = Slider(0, range=-350..350)
a5_2 = Slider(90, range=-119..119)
a3_2 = Slider(90, range=-120..158)
X = Slider(300, range=-2000..2000)
C = Slider(-180, range=-180..180)
e1_3 = Slider(3500, range=1000..4000)
A = Slider(-89.99, range=-180..180)
B = Slider(0, range=-180..180)
Y = Slider(-1500, range=-2000..2000)
Z = Slider(1500, range=-2000..2000)
send_2 = Button()
sendlinearposition = GhPythonScript(X=X, Y=Y, Z=Z, A=A, B=B, C=C, E1=e1_3, Send=Button())  # -> a
# ---------- sendlinearposition: Python ----------
from ghpythonlib.componentbase import executingcomponent as component
import Grasshopper, GhPython
import System
import Rhino
import rhinoscriptsyntax as rs
import sys
import struct
import random
import socket

PY2 = sys.version_info[0] == 2

class MyComponent(component):
    
    def RunScript(self, ip, port, A1, A2, A3, A4, A5, A6, E1, send):
        if send:
            ip = ip or "172.31.1.147"
            port = port or 7000
            client = openshowvar(ip, port)
            
            address = "ghCommand"
            value = "{{MotionCommand: motionType 2 , targetPos {{E6POS: X {}, Y {}, Z {}, A {}, B {}, C {}, E1 {}}}}}".format(A1, A2, A3, A4, A5, A6, E1)
            
            print(value)
            resp = client.write(address, value, False)
            client.close()
            return resp
        # return outputs if you have them; here I try it for you:
        return ""


class openshowvar(object):
    def __init__(self, ip, port):
        self.ip = ip
        self.port = port
        self.msg_id = random.randint(1, 100)
        self.sock = socket.socket(socket.AF_INET, socket.SOCK_STREAM)
        try:
            self.sock.connect((self.ip, self.port))
        except socket.error:
            pass

    def test_connection(self):
        sock = socket.socket(socket.AF_INET, socket.SOCK_STREAM)
        try:
            ret = sock.connect_ex((self.ip, self.port))
            return ret == 0
        except socket.error:
            print('socket error')
            return False

    can_connect = property(test_connection)

    def read(self, var, debug=True):
        if not isinstance(var, str):
            raise Exception('Var name is a string')
        else:
            self.varname = var if PY2 else var.encode(ENCODING)
        return self._read_var(debug)

    def write(self, var, value, debug=True):
        if not (isinstance(var, str) and isinstance(value, str)):
            raise Exception('Var name and its value should be string')
        self.varname = var if PY2 else var.encode(ENCODING)
        self.value = value if PY2 else value.encode(ENCODING)
        return self._write_var(debug)

    def _read_var(self, debug):
        req = self._pack_read_req()
        self._send_req(req)
        _value = self._read_rsp(debug)
        if debug:
            print(_value)
        return _value

    def _write_var(self, debug):
        req = self._pack_write_req()
        self._send_req(req)
        _value = self._read_rsp(debug)
        if debug:
            print(_value)
        return _value

    def _send_req(self, req):
        self.rsp = None
        self.sock.sendall(req)
        self.rsp = self.sock.recv(256)

    def _pack_read_req(self):
        var_name_len = len(self.varname)
        flag = 0
        req_len = var_name_len + 3

        return struct.pack(
            '!HHBH'+str(var_name_len)+'s',
            self.msg_id,
            req_len,
            flag,
            var_name_len,
            self.varname
            )

    def _pack_write_req(self):
        var_name_len = len(self.varname)
        flag = 1
        value_len = len(self.value)
        req_len = var_name_len + 3 + 2 + value_len

        return struct.pack(
            '!HHBH'+str(var_name_len)+'s'+'H'+str(value_len)+'s',
            self.msg_id,
            req_len,
            flag,
            var_name_len,
            self.varname,
            value_len,
            self.value
            )

    def _read_rsp(self, debug=False):
        if self.rsp is None: return None
        var_value_len = len(self.rsp) - struct.calcsize('!HHBH') - 3
        result = struct.unpack('!HHBH'+str(var_value_len)+'s'+'3s', self.rsp)
        _msg_id, body_len, flag, var_value_len, var_value, isok = result
        if debug:
            print('[DEBUG]', result)
        if result[-1].endswith(b'\x01') and _msg_id == self.msg_id:
            self.msg_id = (self.msg_id + 1) % 65536  # format char 'H' is 2 bytes long
            return var_value

    def close(self):
        self.sock.close()
# ---------- end sendlinearposition ----------
sendjointposition = GhPythonScript(A1=a1_3, A2=a2_2, A3=a3_2, A4=a4_2, A5=a5_2, A6=a6_2, E1=e1_2, Send=send_2)  # -> a
# ---------- sendjointposition: Python ----------
from ghpythonlib.componentbase import executingcomponent as component
import Grasshopper, GhPython
import System
import Rhino
import rhinoscriptsyntax as rs
import sys
import struct
import random
import socket

PY2 = sys.version_info[0] == 2

class MyComponent(component):
    
    def RunScript(self, ip, port, A1, A2, A3, A4, A5, A6, E1, send):
        if send:
            ip = ip or "172.31.1.147"
            port = port or 7000
            client = openshowvar(ip, port)
            
            address = "ghCommand"
            value = "{{MotionCommand: motionType 1 , jntPos {{E6AXIS: A1 {}, A2 {}, A3 {}, A4 {}, A5 {}, A6 {}, E1 {}}}}}".format(A1, A2, A3, A4, A5, A6, E1)
            
            print(value)
            resp = client.write(address, value, False)
            client.close()
            return resp
        # return outputs if you have them; here I try it for you:
        return ""


class openshowvar(object):
    def __init__(self, ip, port):
        self.ip = ip
        self.port = port
        self.msg_id = random.randint(1, 100)
        self.sock = socket.socket(socket.AF_INET, socket.SOCK_STREAM)
        try:
            self.sock.connect((self.ip, self.port))
        except socket.error:
            pass

    def test_connection(self):
        sock = socket.socket(socket.AF_INET, socket.SOCK_STREAM)
        try:
            ret = sock.connect_ex((self.ip, self.port))
            return ret == 0
        except socket.error:
            print('socket error')
            return False

    can_connect = property(test_connection)

    def read(self, var, debug=True):
        if not isinstance(var, str):
            raise Exception('Var name is a string')
        else:
            self.varname = var if PY2 else var.encode(ENCODING)
        return self._read_var(debug)

    def write(self, var, value, debug=True):
        if not (isinstance(var, str) and isinstance(value, str)):
            raise Exception('Var name and its value should be string')
        self.varname = var if PY2 else var.encode(ENCODING)
        self.value = value if PY2 else value.encode(ENCODING)
        return self._write_var(debug)

    def _read_var(self, debug):
        req = self._pack_read_req()
        self._send_req(req)
        _value = self._read_rsp(debug)
        if debug:
            print(_value)
        return _value

    def _write_var(self, debug):
        req = self._pack_write_req()
        self._send_req(req)
        _value = self._read_rsp(debug)
        if debug:
            print(_value)
        return _value

    def _send_req(self, req):
        self.rsp = None
        self.sock.sendall(req)
        self.rsp = self.sock.recv(256)

    def _pack_read_req(self):
        var_name_len = len(self.varname)
        flag = 0
        req_len = var_name_len + 3

        return struct.pack(
            '!HHBH'+str(var_name_len)+'s',
            self.msg_id,
            req_len,
            flag,
            var_name_len,
            self.varname
            )

    def _pack_write_req(self):
        var_name_len = len(self.varname)
        flag = 1
        value_len = len(self.value)
        req_len = var_name_len + 3 + 2 + value_len

        return struct.pack(
            '!HHBH'+str(var_name_len)+'s'+'H'+str(value_len)+'s',
            self.msg_id,
            req_len,
            flag,
            var_name_len,
            self.varname,
            value_len,
            self.value
            )

    def _read_rsp(self, debug=False):
        if self.rsp is None: return None
        var_value_len = len(self.rsp) - struct.calcsize('!HHBH') - 3
        result = struct.unpack('!HHBH'+str(var_value_len)+'s'+'3s', self.rsp)
        _msg_id, body_len, flag, var_value_len, var_value, isok = result
        if debug:
            print('[DEBUG]', result)
        if result[-1].endswith(b'\x01') and _msg_id == self.msg_id:
            self.msg_id = (self.msg_id + 1) % 65536  # format char 'H' is 2 bytes long
            return var_value

    def close(self):
        self.sock.close()
# ---------- end sendjointposition ----------
merge = Merge(Data1=a1_3, Data2=a2_2, Data3=a3_2, Data4=a4_2, Data5=a5_2, Data6=a6_2)
degtorad = DegreesToRadians(Degrees=merge, RobotSystem=loadrobot, MechanicalGroup=0)
panel_2 = Panel(sendlinearposition)
panel_3 = Panel(sendjointposition)
target = CreateTarget(Joints=degtorad, External=e1_2, IsCartesian=False)
K = Kinematics(RobotSystem=loadrobot, Target=target, DisplayGeometry=True)  # -> Meshes, Joints, Planes, Errors
